% Requirement links of Com_pedis.slx (R2020b)

block :4:17 implements light_req.slreqx#6: pedestrian's light: when in pedestrian's green and count gratter or equal 55 , pedR is on
block :4:18 implements light_req.slreqx#7: pedestrian's red light : when in pedestrian's red and sigR is one, pedG is on