% Requirement links of Com_trafficl.slx (R2020b)

block :3:31 implements light_req.slreqx#5: yellow's car: when in green state and have pedestrian and count gratter or equal 60 , sigY is on
block :3:32 implements light_req.slreqx#4: red's car: when in yellow state and count gratter or equal 5 sigR is on
block :3:33 implements light_req.slreqx#3: yellow: when the satate is pending count gratter or equal 60 , signal yellow is on
block :3:35 implements light_req.slreqx#1: car's green: count gratter or equal 60 green light is on
block :3:38 implements light_req.slreqx#2: pending state: pedestran is comeing and count lower than 60 , pending state is on