# Requirement set light_req (R2020b)

## 1 [car's green] count gratter or equal 60 green light is on

## 2 [pending state] pedestran is comeing and count lower than 60 , pending state is on

## 3 [yellow] when the satate is pending count gratter or equal 60 , signal yellow is on

## 4 [red's car] when in yellow state and count gratter or equal 5 sigR is on

## 5 [yellow's car] when in green state and have pedestrian and count gratter or equal 60 , sigY is on

## 6 [pedestrian's light] when in pedestrian's green and count gratter or equal 55 , pedR is on

## 7 [pedestrian's red light] when in pedestrian's red and sigR is one, pedG is on