# Requirement set requirement (R2022a)

## 1 [Pending to Yellow] cars light -> Yellow
زمانی که در حالت pending باشیم و count بزرگتر مساوی 60 شود ، چراغ زرد روشن میشود وSigY فعال میشود

## 2 [Red to Green] cars light -> green
در حالت Red اگر count بزرگتر مساوی 60 شود ، چراغ سبز روشن میشود و SigG فعال میشود

## 3 [Yellow to Red] cars light -> Red
در حالت Yellow اگر count بزرگتر مسساوی 5 شود ، چراغ قرمز میشود و SigR فعال میشود

## 4 [Green to Pending] go to pending
در حالت Green اگر عابرپیاده بیاید و count کوچکتر از 60 باشد ، به pending میرویم

## 5 [Green to Yellow] cars light -> Yellow
در حالت Green اگر عابرپیاده بیاید و countبزرگتر مساوی 60 باشد ، چراغ زرد میشود و SigY فعال میشود

## 6 [Green to Red for Pedestrian] Pedestrian light -> Red
اگر چراغ عابرپیاده سبز باشد و pcount بزرگتر مساوی 55 شود ، چراغ قرمز میشود و PedR فعال میشود

## 7 [Red to Green for Pedestrian] Pedestrian light -> Green
اگر چراغ عابرپیاده قرمز باشد و SigR فعال شود ، چراغ سبز میشود